# Grasshopper definition GHSolar_Test.gh (Grasshopper 0.9.76)
# plug-ins: GHSolar

mesh = Mesh([<mesh referenced from the Rhino model> x100])

# ---- group: Data reader
panel = Panel("C:\Users\wach\Desktop\SolarV2\DNI.txt")  # disabled
panel_2 = Panel("C:\Users\wach\Desktop\SolarV2\DHI.txt")  # disabled
panel_3 = Panel("C:\Users\wach\Desktop\SolarV2\SNOW.txt")  # disabled
readtxt = ReadText(Path=panel)  # disabled
readtxt_2 = ReadText(Path=panel_2)  # disabled
readtxt_3 = ReadText(Path=panel_3)  # disabled

# ---- group: albedos
panel_4 = Panel("C:\Users\wach\Desktop\SolarV2\albedosGlass.txt")  # disabled
readtxt_4 = ReadText(Path=panel_4)  # disabled

# ----
mjoin = MeshJoin(Meshes=mesh)

# ---- group: analysis surface
srf = Surface(<surface referenced from the Rhino model>)
mesh_uv = MeshSurface(Surface=srf, UCount=Slider(9, range=0..100), VCount=Slider(6, range=0..100), Overhang=True, Equalize=False)
mesh_2 = Mesh(mesh_uv)

# ----
data = Data([0, 0, 0, 0, 0, 0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])
data_2 = Data([0, 0, 0, 0, 0, 0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])
data_3 = Data([0, 0, 0, 0, 0, 0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])

# ---- group: obstacles
mesh_3 = Mesh([<mesh referenced from the Rhino model> x6])

# ----
srf_2 = Surface([<surface referenced from the Rhino model> x2])
srf_3 = Surface(<surface referenced from the Rhino model>)

# ---- group: weather
panel_5 = Panel(data)
panel_6 = Panel(data_2)
panel_7 = Panel(data_3)

# ----
mesh_uv_2 = MeshSurface(Surface=srf_2, UCount=Slider(1, range=0..100), VCount=Slider(1, range=0..100), Overhang=True, Equalize=False)
mesh_4 = Mesh(mesh_uv_2)

data_4 = Data([0.8, 0.8, 0.8, 0.8, 0.8, 0.8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])
panel_8 = Panel(data_4)
toggle = BooleanToggle(True)
mesh_5 = Mesh(mesh_4)

# ---- group: Latitude
panel_9 = Panel("47.367347")

# ---- group: Longitude
panel_10 = Panel("8.5500025")

# ----
toggle_2 = BooleanToggle(False)
obstobj = ObstacleObject(Mesh=mesh_5, Albedo=panel_8, SpecCoeff=panel_8, ReflType="0", Tolerance="0.02", Name="stuff", MT=toggle)
obstobj_2 = ObstacleObject(Mesh=mesh_2, Albedo=panel_8, SpecCoeff=panel_8, ReflType="0", Tolerance="0.02", Name="analysis", MT=toggle)
mesh_uv_3 = MeshSurface(Surface=srf_3, UCount="2", VCount="2", Overhang=True, Equalize=False)
item = ListItem(List=flatten(mesh_uv_3), Index=0, Wrap=True)
mesh_6 = Mesh(item)
mesh_7 = Mesh(<mesh referenced from the Rhino model>)
obstobj_3 = ObstacleObject(Mesh=mesh_7, Albedo=panel_8, SpecCoeff=panel_8, ReflType="1", Tolerance="0.02", Name="stuff", MT=toggle)
irrmshy = IrradiationMeshYear(
    AnalysisMesh=mesh_2,
    Latitude=panel_9,
    Longitude=panel_10,
    DNI=panel_7,
    DHI=panel_5,
    Snow=panel_6,
    Year="2013",
    SkydomeResolution="2",
    InterpolationMode="1",
    MT=toggle_2)  # disabled

# ---- group: trees dense
panel_11 = Panel("C:\Users\wach\Desktop\SolarV2\leaves_dense.txt")  # disabled
readtxt_5 = ReadText(Path=panel_11)  # disabled

# ---- group: trees medium
panel_12 = Panel("C:\Users\wach\Desktop\SolarV2\leaves_medium.txt")  # disabled
readtxt_6 = ReadText(Path=panel_12)  # disabled

# ---- group: trees light
panel_13 = Panel("C:\Users\wach\Desktop\SolarV2\leaves_light.txt")  # disabled
readtxt_7 = ReadText(Path=panel_13)  # disabled

# ----
matrix = Matrix()  # disabled
data_5 = Data([0.1, 0.1, 0.1, 0.1, 0.1, 0.1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])
data_6 = Data([0.5, 0.5, 0.5, 0.5, 0.5, 0.5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])
data_7 = Data([0.8, 0.8, 0.8, 0.8, 0.8, 0.8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])
mesh_8 = Mesh(<mesh referenced from the Rhino model>)
mesh_9 = Mesh(<mesh referenced from the Rhino model>)
mesh_10 = Mesh(<mesh referenced from the Rhino model>)

# ---- group: 8760 profiles foreach vertex
number_slider = Slider(75, range=0..120)  # disabled
c_script = CSharpScript(x=matrix, y=number_slider)  # -> out, A; inputs y: Int32; disabled
# ---------- c_script: C# ----------
//    Dim m As matrix
//    m = x
//
//    Dim test(m.ColumnCount - 1) As Double
//    Dim i As Integer
//    For i = 1 To m.ColumnCount - 1
//    test(i - 1) = m.item(y, i)
//    Next
//
//      A = test
    
    Matrix m = null;

    m = (Matrix) x;
    double [] test = new double[m.ColumnCount];
    for(int i = 0; i < m.ColumnCount; i++)
    {
      test[i] = m[y,i];
    }

    A = test;
# ---------- end c_script ----------
panel_14 = Panel(c_script.A)  # disabled

# ----
treeobst = TreeObstacle(Mesh=mesh_9, Leaves=data_5)

# ---- group: mesh visualization per hour of year
number_slider_2 = Slider(2508, range=0..8759)  # disabled
c_script_2 = CSharpScript(x=matrix, y=number_slider_2)  # -> out, A; inputs y: Int32; disabled
# ---------- c_script_2: C# ----------
    Matrix m = null;
    
    m = (Matrix)x;
    double [] test = new double[m.RowCount];
    for(int i = 0; i < m.RowCount; i++)
    {
      test[i] = m[i, y];
    }

    A = test;
# ---------- end c_script_2 ----------
panel_15 = Panel(c_script_2.A)  # disabled

# ----
treeobst_2 = TreeObstacle(Mesh=mesh_8, Leaves=data_6)
treeobst_3 = TreeObstacle(Mesh=mesh_10, Leaves=data_7)
data_8 = Data("Grasshopper.Kernel.Types.GH_ObjectWrapper")
irrmshh = IrradiationMeshhour(
    AnalysisObjects=obstobj_2,
    ObstacleObjects=obstobj_2,
    TreeObject=[treeobst, treeobst_2, treeobst_3],
    Latitude=panel_9,
    Longitude=panel_10,
    DNI=panel_7,
    DHI=panel_5,
    Snow=panel_6,
    Year="2013",
    Month=Slider(12, range=1..30),
    Day=Slider(2, range=1..12),
    Hour=Slider(10, range=0..23),
    SpecBounces="2",
    SkydomeResolution="2",
    DiffInterreflRes="1",
    MT=toggle_2)  # -> Vec, Results, Irefl
number_slider_3 = Slider(0, range=0..7)
visumshsol = VisualizeMeshSolar(
    Mesh=mesh_2,
    I=irrmshh.Results,
    Value=number_slider_3,
    Hour=Slider(731, range=0..8759),
    Min="50",
    Max="70",
    Clr=Slider(1, range=0..2))
readresults = ReadResults(Mesh=mesh_2, I=irrmshh.Results, Value=number_slider_3, SP=Slider(50, range=0..100))  # -> Results, SP
panel_16 = Panel(readresults.Results)
